# Dynamo graph AU_Master.dyn (Dynamo 2.0.2.6826)

# note: alternative inputs

# group: Custom Node Setup
code_block = CodeBlock { UserGuideURL : string = ""; }
code_block_2 = CodeBlock { inputList : var[]..[]; }  # unwired: inputList
code_block_3 = CodeBlock()
# ---------- code_block_3.designscript (2 lines) ----------
// short user message to display within the UI
UserMessage : string = " ";
# ----------------------------------------
code_block_4 = CodeBlock { Run : bool = false; }
code_block_5 = CodeBlock { x[0]; x[1]; }  # unwired: x
code_block_6 = CodeBlock(SelectedItem=code_block_5.out1) { SelectedItem; }
code_block_7 = CodeBlock(RunComplete=code_block_5.out0) { RunComplete; }

# group: Python file
file_path = Filename("step Python Files\Step5_FinishingTouches.py")
file_from_path = FileObject(path=file_path)
readText = FileSystem.ReadText(file=file_from_path)

# group: Inputs
boolean = BoolSelector(true)
message = StringInput("Select an item from drop the list:")
inputs = CodeBlock { 1..5; }
helpLink = StringInput("https://gems.autodesk.com/events/au-london-2019/event-summary-9d39b233a0fe42d385650e63507680c9.aspx")
helplink_alternative = StringInput("C:\Users\benrobinson\Desktop\RE_ 17002 - Briefing Tool - Feedback .pdf")
categories = Categories(index=220)
all_elements_of_category = ElementsOfCategory(Category=categories)
getFamily = FamilyInstance.GetFamily(familyInstance=all_elements_of_category)

# group: Logo files
file_path_au_logo = Filename("images\au_Logo.png")  # graph input
fromPath = FileObject(path=file_path_au_logo)  # "File.FromPath"
readFromFile = Image.ReadFromFile(file=fromPath)
file_path_icon_file = Filename("images\hbIcon.png")  # graph input
fromPath_2 = FileObject(path=file_path_icon_file)  # "File.FromPath"
readFromFile_2 = Image.ReadFromFile(file=fromPath_2)

# group: GUI
python_script_from_string = PythonStringNode(script=readText, IN[0]=boolean, IN[1]=message, IN[2]=inputs, IN[3]=helpLink, IN[4]=readFromFile, IN[5]=readFromFile_2)
code_block_8 = CodeBlock(x=python_script_from_string) { userOutput = x[0]; runNextOutput= x[1]; }
watch = Watch(code_block_8.userOutput)
watch_2 = Watch(code_block_8.runNextOutput)

# group: thanks GIF
# note: Currently the only way i have figured out for the GUI to play a GIF is to load the GIF in a different method to how we have loaded the logo files on the previous node
file_path_2 = Filename("images\goodJobGIF.gif")  # graph input
python_script = Python(IN[0]=code_block_8.runNextOutput, IN[1]=file_path_2, IN[2]=readFromFile_2)
# ---------- python_script.python (71 lines) ----------
import clr

clr.AddReference("System.Windows.Forms")
clr.AddReference("System.Drawing")

from System.Windows.Forms import Application, Form, FormWindowState, Screen, Label, PictureBox, PictureBoxSizeMode, AnchorStyles, BorderStyle, ComboBox, ComboBoxStyle, FormBorderStyle, Button
from System.Drawing import Icon, Color, Font, Point, Size

clr.AddReference('RevitAPIUI')
from  Autodesk.Revit.UI import Selection

clr.AddReference('RevitNodes')
import Revit
clr.ImportExtensions(Revit.Elements)
clr.ImportExtensions(Revit.GeometryConversion)

clr.AddReference('RevitServices')
from RevitServices.Persistence import DocumentManager
doc = DocumentManager.Instance.CurrentDBDocument
uidoc = DocumentManager.Instance.CurrentUIApplication.ActiveUIDocument

import sys
pyt_path = r'C:\Program Files (x86)\IronPython 2.7\Lib'
sys.path.append(pyt_path)

run = IN[0]
image = IN[1]
icon = IN[2]

class IForm(Form):

    def __init__(self):

        spacing = 10
        
        self.Text = ' Thank you AU London!!!'
        self.Icon = Icon.FromHandle(icon.GetHicon())
        self.Size = Size(380, 300)
        self.CenterToScreen()
        self.FormBorderStyle = FormBorderStyle.FixedDialog
        font = Font("Helvetica ", 10)
        
        uiWidth = self.DisplayRectangle.Width    #get the size of the form to use to scale form elements
        uiHeight = self.DisplayRectangle.Height
        
        btn = Button()
        btn.Parent = self
        btn.Text = "Close"
        btn.Location = Point(uiWidth-(btn.Width + spacing) , uiHeight - (btn.Height + spacing))
        btn.Click += self.CnlButtonPressed
        btn.Anchor = AnchorStyles.Bottom

        pb = PictureBox()
        pb.Parent = self
        pb.Size = Size(380, 300)
        pb.Location = Point(0, 0)
        pb.ImageLocation = image 
        pb.SizeMode = PictureBoxSizeMode.Zoom



    def CnlButtonPressed(self, sender, args):
        self.Close()


form = IForm()
  
if run == True:

    Application.Run(form)
    
# ----------------------------------------
